# Dynamo graph Extract JSON data.dyn (Dynamo 3.4.1.7055)

file_path = Filename("C:\Users\Gavin\Downloads\IfcDump.ndjson")
file_from_path = FileObject(path=file_path)
readText = FileSystem.ReadText(file=file_from_path)
code_block = CodeBlock { "\n"; }
split = String.Split(string=readText, separator0=code_block)
parseJSON = Data.ParseJSON(json=split)
code_block_2 = CodeBlock { "GlobalId"; }
valueAtKey = DesignScript.Builtin.Dictionary.ValueAtKey(dictionary=parseJSON, key=code_block_2)
categories = Categories("OST_Rooms")
all_elements_of_category = ElementsOfCategory(Category=categories)
code_block_3 = CodeBlock { "IfcGUID"; }
getParameterValueByName = Element.GetParameterValueByName(element=all_elements_of_category, parameterName=code_block_3)
indexOf = List.IndexOf(list=valueAtKey, element=getParameterValueByName)
code_block_4 = CodeBlock(i=indexOf) { i > -1; }
filterByBoolMask = List.FilterByBoolMask(list=indexOf, mask=code_block_4)
getItemAtIndex = List.GetItemAtIndex(list=parseJSON, index=filterByBoolMask.in)
code_block_5 = CodeBlock { "Name"; }
valueAtKey_2 = DesignScript.Builtin.Dictionary.ValueAtKey(dictionary=getItemAtIndex, key=code_block_5)
ifc_derived_data = Watch(valueAtKey_2)
filterByBoolMask_2 = List.FilterByBoolMask(list=all_elements_of_category, mask=code_block_4)
number = Room.Number(room=filterByBoolMask_2.in)
revit_specific_data = Watch(number)
